# Grasshopper definition initNet.gh (Grasshopper 0.9.76)

brep = Brep(<brep referenced from the Rhino model>)
bbox = BoundingBox(Content=brep, Plane=PlaneXY(0, 0, 0))  # -> Box, Box_2
pop3d = Populate3D(Region=bbox.Box, Count=50, Seed=1)
brepinc = PointInBrep(Brep=brep, Point=pop3d, Strict=True)
cull = CullPattern(List=pop3d, CullPattern=brepinc)
sph = Sphere(Base=cull, Radius=1)
col = Colour(RGB(255, 0, 0))
preview = CustomPreview(Geometry=sph, Shader=col)
