# Grasshopper definition porous_net.gh (Grasshopper 0.9.76)
# plug-ins: Python Interpreter, LunchBox

file = ReadFile(File="Z:\Documents\beam\femur.csv", PerLineParse=True)
csv = ReadCSV(CSVString=file, Delimiter=",")  # -> Headers, Values
branch = TreeBranch(Tree=csv.Values, Path="{0}", MaintainPaths=True)
branch_2 = TreeBranch(Tree=csv.Values, Path="{1}", MaintainPaths=True)
branch_3 = TreeBranch(Tree=csv.Values, Path="{2}", MaintainPaths=True)
branch_4 = TreeBranch(Tree=csv.Values, Path="{3}", MaintainPaths=True)
pt = ConstructPoint(XCoordinate=branch, YCoordinate=branch_2, ZCoordinate=branch_3)
python = PythonScript(individuals=branch_4, k=50)  # -> out, chosen; inputs individuals: list, k: Int32
# ---------- python: Python ----------
import random
# s_inds = sorted(individuals, reverse=True)
sum_fits = sum(individuals)

chosen = []
for i in xrange(k):
    u = random.random() * sum_fits
    print u
    sum_ = 0
    for pos_ind, ind in enumerate(individuals):
        sum_ += ind
        if sum_ > u:
            if pos_ind in chosen:
                continue
            chosen.append(pos_ind)
            break
# ---------- end python ----------
item = ListItem(List=pt, Index=python.chosen, Wrap=True)

file_2 = ReadFile(File="Z:\Documents\beam\edges.csv", PerLineParse=True)
csv_2 = ReadCSV(CSVString=file_2, Delimiter=",")  # -> Headers, Values
branch_5 = TreeBranch(Tree=csv_2.Values, Path="{0}", MaintainPaths=True)
branch_6 = TreeBranch(Tree=csv_2.Values, Path="{1}", MaintainPaths=True)
data = Data(item)
item_2 = ListItem(List=data, Index=branch_6, Wrap=True)
item_3 = ListItem(List=data, Index=branch_5, Wrap=True)
sph = Sphere(Base=data, Radius=0.4)
ln = Line(StartPoint=item_3, EndPoint=item_2)
merge = Merge(Data1=sph, Data2=ln)

col = Colour(RGB(255, 0, 0))
preview = CustomPreview(Geometry=merge, Shader=col)
rot3d = Rotate3D(Geometry=<brep referenced from the Rhino model>, Angle=-1.570796327, Center=Point(0, 0, 0), Axis=Vector(0, 0, 1))  # -> Geometry, Transform
