# Grasshopper definition reducemesh.gh (Grasshopper 0.9.76)
# plug-ins: Python Interpreter, Anemone, LunchBox, Weaverbird

python = PythonScript()  # -> out, a
# ---------- python: Python ----------
import sys, os,re
import rhinoscriptsyntax as rs
work_dir = os.environ["BeamDir"]
sys.path.append(work_dir)
from constModu import *
import myutil
porousfiles = [f for f in os.listdir(parts_dir) if re.search('part_\d{1,2}\.obj', f)]
for f in porousfiles:
    voro=myutil.importfile(parts_dir+f)
    rs.RemoveObjectFromAllGroups(voro)
    print voro
# ---------- end python ----------
mshreduce = MeshReduce(Mesh=python.out, TargetSize=Slider(400, range=0..1000), Distort=True, Accuracy=5, NormalizeSize=False)

number_slider = Slider(35, range=0..100)
lng = ListLength(List=mshreduce)

wbvertices = WeaverbirdsVerticesComponent(MeshClosedPolylinesGroup=mshreduce, Weld=True)
avr = Average(Input=wbvertices)  # -> flatten(ArithmeticMean)
random = Random(Range=Domain(0.6, 1), Number=lng, Seed=2)
scale = Scale(Geometry=mshreduce, Center=avr, Factor=random)  # -> Geometry, Transform

loop_start = LoopStart(Repeat=expr("x-1", lng), Trigger=lng)  # -> port, Counter, Data
item = ListItem(List=mshreduce, Index=loop_start.Counter, Wrap=True)
wbcatmullclark = WeaverbirdsCatmullClarkSubdivision(MeshCurves=item, Level=1, SmoothNakedEdges=1)

wbvertices_2 = WeaverbirdsVerticesComponent(MeshClosedPolylinesGroup=wbcatmullclark, Weld=True)  # -> flatten(Points)
cullpt = CullDuplicates(Points=wbvertices_2, Tolerance=0.05, CullMode=3)  # -> Points, Indices, Valence
difference = SetDifference(SetA=wbvertices_2, SetB=cullpt.Points)
index = ItemIndex(List=wbvertices_2, Item=difference)
deletev = DeleteVertices(Mesh=wbcatmullclark, Indices=index, Shrink=True)

python_2 = PythonScript(ind=loop_start.Counter)  # -> out, dirname, filename
# ---------- python_2: Python ----------
import sys, os
work_dir = os.environ["BeamDir"]
sys.path.append(work_dir)
from constModu import *
dirname=parts_dir
filename="voro_%d.sat"%(ind)
# ---------- end python_2 ----------

faceb = FaceBoundaries(Mesh=deletev)
explode = Explode(Curve=faceb, Recursive=True)  # -> Segments, Vertices
item_2 = ListItem(List=explode.Segments, Index=0, Wrap=True)  # -> flatten(Item), flatten(Item1), flatten(Item2), flatten(Item3)
edgesrf = EdgeSurface(CurveA=item_2.Item, CurveB=item_2.Item1, CurveC=item_2.Item2, CurveD=item_2.Item3)
area = Area(Geometry=edgesrf)  # -> Area, Centroid
larger = LargerThan(FirstNumber=area.Area, SecondNumber=0.01)  # -> LargerThan, OrEqualTo
cull = CullPattern(List=edgesrf, CullPattern=larger.LargerThan)
join = BrepJoin(Breps=cull)  # -> Breps, Closed
item_3 = ListItem(List=join.Breps, Index=0, Wrap=True)

capex = CapHolesEx(Brep=item_3)  # -> Brep, Caps, Solid
save = ObjectSave(
    BakeToggle=True,
    FileDirectory=python_2.dirname,
    FileName=python_2.filename,
    GeometryObjects=capex.Brep,
    Layer="GH_Export",
    ObjectName="GH_Obj",
    ObjectColor=RGB(255, 255, 255),
    LayerColor=RGB(255, 255, 255))
loop_end = LoopEnd(port=loop_start.port, Exit=False, Data=capex.Brep, pausedState=False, state="Last & Record", TimeOutVal=0)  # -> flatten(Data)
geo = Geometry(loop_end)
