# Grasshopper definition simple.gh (Grasshopper 0.9.76)
# plug-ins: LunchBox, Weaverbird

mesh = MeshBrep(
    Brep=<geometry referenced from the Rhino model>,
    Settings={GridMaxCount=0, GridMinCount=16, JaggedSeams=False, MaxEdgeLength=0, MinEdgeLength=0.0001, MinTolerance=0, Refine=True, RefineAngle=0, RelativeTolerance=0.65, SimplePlanes=True, Tolerance=0})
mshreduce = MeshReduce(Mesh=mesh, TargetSize=Slider(500, range=0..1000), Distort=True, Accuracy=5, NormalizeSize=False)
wbcatmullclark = WeaverbirdsCatmullClarkSubdivision(MeshCurves=mshreduce, Level=1, SmoothNakedEdges=1)

faceb = FaceBoundaries(Mesh=wbcatmullclark)
explode = Explode(Curve=faceb, Recursive=True)  # -> Segments, Vertices
item = ListItem(List=explode.Segments, Index=0, Wrap=True)  # -> flatten(Item), flatten(Item1), flatten(Item2), flatten(Item3)
edgesrf = EdgeSurface(CurveA=item.Item, CurveB=item.Item1, CurveC=item.Item2, CurveD=item.Item3)
join = BrepJoin(Breps=edgesrf)  # -> Breps, Closed

sdiff = SolidDifference(BrepsA=join.Breps)
