# Grasshopper definition voro.gh (Grasshopper 0.9.76)
# plug-ins: Python Interpreter, Anemone, LunchBox, Weaverbird

number_slider = Slider(44, range=0..100)
vorocnt = Data(50)

python = PythonScript()  # -> out, F
# ---------- python: Python ----------
import sys, os
work_dir = os.environ["BeamDir"]
sys.path.append(work_dir)
from constModu import *
F=os.path.splitext(modelstp)[0]+".csv"
# ---------- end python ----------
file = ReadFile(File=python.F, PerLineParse=True)
csv = ReadCSV(CSVString=file, Delimiter=",")  # -> Headers, Values
branch = TreeBranch(Tree=csv.Values, Path="{0}", MaintainPaths=True)
branch_2 = TreeBranch(Tree=csv.Values, Path="{1}", MaintainPaths=True)
branch_3 = TreeBranch(Tree=csv.Values, Path="{2}", MaintainPaths=True)
branch_4 = TreeBranch(Tree=csv.Values, Path="{3}", MaintainPaths=True)
pt = ConstructPoint(XCoordinate=branch, YCoordinate=branch_2, ZCoordinate=branch_3)
python_2 = PythonScript(individuals=branch_4, k=vorocnt)  # -> out, chosen; inputs individuals: list, k: Int32
# ---------- python_2: Python ----------
import random
# s_inds = sorted(individuals, reverse=True)
sum_fits = sum(individuals)

chosen = []
for i in xrange(k):
    u = random.random() * sum_fits
    print u
    sum_ = 0
    for pos_ind, ind in enumerate(individuals):
        sum_ += ind
        if sum_ > u:
            if pos_ind in chosen:
                continue
            chosen.append(pos_ind)
            break
# ---------- end python_2 ----------
item = ListItem(List=pt, Index=python_2.chosen, Wrap=True)

number_slider_2 = Slider(5, range=0..10)
inputbrep = Brep(<brep referenced from the Rhino model>)
voronoi³ = Voronoi3D(Points=item, Box=inputbrep)  # -> Cells, Boundary
loop_start = LoopStart(Repeat=number_slider_2, Trigger=number_slider_2, Data=voronoi³.Cells)  # -> port, Counter, Data

sint = SolidIntersection(BrepsA=loop_start.Data, BrepsB=inputbrep)

volume = Volume(Geometry=sint)  # -> Volume, Centroid
voronoi³_2 = Voronoi3D(Points=volume.Centroid, Box=inputbrep)  # -> Cells, Boundary
loop_end = LoopEnd(port=loop_start.port, Exit=False, Data=voronoi³_2.Cells, pausedState=False, state="Output last", TimeOutVal=0)

sint_2 = SolidIntersection(BrepsA=loop_end, BrepsB=inputbrep)
volume_2 = Volume(Geometry=sint_2)  # -> Volume, Centroid
larger = LargerThan(FirstNumber=volume_2.Volume, SecondNumber=1)  # -> LargerThan, OrEqualTo
cull = CullPattern(List=sint_2, CullPattern=larger.LargerThan)
mesh = MeshBrep(
    Brep=cull,
    Settings={GridMaxCount=0, GridMinCount=16, JaggedSeams=False, MaxEdgeLength=0, MinEdgeLength=0.0001, MinTolerance=0, Refine=True, RefineAngle=0, RelativeTolerance=0.65, SimplePlanes=True, Tolerance=0})

data = Data(mesh)
wbvertices = WeaverbirdsVerticesComponent(MeshClosedPolylinesGroup=data, Weld=True)
avr = Average(Input=wbvertices)  # -> flatten(ArithmeticMean)
lng = ListLength(List=data)
random = Random(Range=Domain(0.6, 1), Number=lng, Seed=2)
scale = Scale(Geometry=data, Center=avr, Factor=random)  # -> Geometry, Transform

data_2 = Data(scale.Geometry)
lng_2 = ListLength(List=data_2)
loop_start_2 = LoopStart(N=expr("x-1", lng_2), T=lng_2, D0=1, D1=0)  # -> port, Counter, Data, Data_2
item_2 = ListItem(List=data_2, Index=loop_start_2.Counter, Wrap=True)
python_3 = PythonScript(ind=loop_start_2.Counter, s=item_2)  # -> out, dirname, filename; disabled
# ---------- python_3: Python ----------
import sys, os
work_dir = os.environ["BeamDir"]
sys.path.append(work_dir)
from constModu import *
import rhinoscriptsyntax as rs
work_dir = os.environ.get("BeamDir", "/Users/hepburn/Documents/beam/")
parts_dir = work_dir + modelname + "_parts/"
dirname=parts_dir
filename="part_%d.stp"%(ind)
if ind==0:
    with open(work_dir + modelname + "_centroid.csv",'w') as f:
        f.write("id,x,y,z\n")
centroid,_=rs.SurfaceAreaCentroid(s)
with open(work_dir + modelname + "_centroid.csv",'a') as f:
    f.write("%d,%f,%f,%f\n"%(ind,centroid[0],centroid[1],centroid[2]))
# ---------- end python_3 ----------
save = ObjectSave(
    BakeToggle=True,
    FileDirectory=python_3.dirname,
    FileName=python_3.filename,
    GeometryObjects=item_2,
    Layer="GH_Export",
    ObjectName="GH_Obj",
    ObjectColor=RGB(255, 255, 255),
    LayerColor=RGB(255, 255, 255))  # disabled

mshreduce = MeshReduce(Mesh=item_2, TargetSize=100, Distort=True, Accuracy=5, NormalizeSize=False)

wbcatmullclark = WeaverbirdsCatmullClarkSubdivision(MeshCurves=mshreduce, Level=Slider(2, range=0..10), SmoothNakedEdges=1)
mshreduce_2 = MeshReduce(Mesh=wbcatmullclark, TargetSize=Slider(100, range=0..1000), Distort=True, Accuracy=5, NormalizeSize=False)
wbcatmullclark_2 = WeaverbirdsCatmullClarkSubdivision(MeshCurves=mshreduce_2, Level=Slider(2, range=0..10), SmoothNakedEdges=1)
python_4 = PythonScript(ind=loop_start_2.Counter)  # -> out, dirname, filename
# ---------- python_4: Python ----------
import sys, os
work_dir = os.environ["BeamDir"]
sys.path.append(work_dir)
from constModu import *
dirname=parts_dir
filename="voro_%d.stp"%(ind)
# ---------- end python_4 ----------

faceb = FaceBoundaries(Mesh=wbcatmullclark_2)
explode = Explode(Curve=faceb, Recursive=True)  # -> Segments, Vertices
item_3 = ListItem(List=explode.Segments, Index=0, Wrap=True)  # -> flatten(Item), flatten(Item1), flatten(Item2), flatten(Item3)
edgesrf = EdgeSurface(CurveA=item_3.Item, CurveB=item_3.Item1, CurveC=item_3.Item2, CurveD=item_3.Item3)
join = BrepJoin(Breps=edgesrf)  # -> Breps, Closed

loop_end_2 = LoopEnd(
    port=loop_start_2.port,
    Exit=False,
    Data=loop_start_2.Data,
    Data_2=wbcatmullclark_2,
    pausedState=False,
    state="Last & Record",
    TimeOutVal=0)  # -> D0, D1

save_2 = ObjectSave(
    BakeToggle=True,
    FileDirectory=python_4.dirname,
    FileName=python_4.filename,
    GeometryObjects=join.Breps,
    Layer="GH_Export",
    ObjectName="GH_Obj",
    ObjectColor=RGB(255, 255, 255),
    LayerColor=RGB(255, 255, 255))  # disabled

python_5 = PythonScript(cnt=lng_2, lend=loop_end_2.D0)  # -> out, a; disabled
# ---------- python_5: Python ----------
import Rhino
import scriptcontext as sc
import rhinoscriptsyntax as rs

if cnt and lend:
    Grasshopper = Rhino.RhinoApp.GetPlugInObject("Grasshopper")
    sc.doc=Rhino.RhinoDoc.ActiveDoc
    Grasshopper.CloseDocument()
    rs.DocumentModified(False)
    rs.Exit()
# ---------- end python_5 ----------
geo = Geometry(loop_end_2.D1)
